% Simulink data dictionary PMSM_plant_parameters.sldd

Cdc = 0.001
ID_MAP = reshape([-123.4861 -123.4861 -123.4861 -123.4861 -44.19876 -53.05577 -71.18225 -83.75405 -83.20174 -88.43946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], 17, 83, 4)
IQ_MAP = reshape([-339.5216 -339.5216 -339.5216 -339.5216 -298.6383 -232.8762 -192.9958 -164.3337 -138.4718 -120.4565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], 17, 83, 4)
Jm = 0.1234
L0 = 0.00012184
Ld = 0.00024368
Lq = 0.00029758
Pmax = 35000
RPM_VECT = [0 500 1000 1500 2000 2500 3000 3500 4000 4500 5000 5500 6000 6500 7000 7500 8000]
Rs = 0.010087
TQ_VECT = [-205 -200 -195 -190 -185 -180 -175 -170 -165 -160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 205]
Tmax = 205
V1 = 290
VDC_VECT = [275 300 325 350]
Vnom = 325
dend_id = [1 -0.95]
dend_iq = [1 -0.95]
dend_omega = [1 -0.5]
fsw = 10000
numd_id = 0.05
numd_iq = 0.05
numd_omega = 0.5
p = 8
psim = 0.04366
V_init = Simulink.Parameter(377)