% Simulink data dictionary PMSM_system_data.sldd
% references PMSM_plant_parameters.sldd
% references ctrl_parameters.sldd
% references battery_pack_model_data.sldd

DOUBLE = Simulink.NumericType(DataTypeMode="Double", SignednessBool=true, WordLength=64, FixedExponent=0)

sensor_bus = Simulink.Bus()
  iabc: double[3], Unit="A"  % abc相電流
  rotation_speed: double, Unit="rad/s"  % モーター回転数
  angle: double, Unit="rad"  % モーター回転角度
  V_dc: double, Unit="V"  % 直流電圧
  Tq: double, Unit="N*m"  % モータートルク

FLOAT = Simulink.NumericType(DataTypeMode="Single", SignednessBool=true, WordLength=32, FixedExponent=0)
INT_32 = Simulink.NumericType(DataTypeMode="Fixed-point: unspecified scaling", SignednessBool=true, WordLength=32, FixedExponent=0)
INT_16 = Simulink.NumericType(DataTypeMode="Fixed-point: unspecified scaling", SignednessBool=true, WordLength=16, FixedExponent=0)
INT_8 = Simulink.NumericType(DataTypeMode="Fixed-point: unspecified scaling", SignednessBool=true, WordLength=8, FixedExponent=0)
UINT_16 = Simulink.NumericType(DataTypeMode="Fixed-point: unspecified scaling", SignednessBool=false, WordLength=16, FixedExponent=0)
UINT_8 = Simulink.NumericType(DataTypeMode="Fixed-point: unspecified scaling", SignednessBool=false, WordLength=8, FixedExponent=0)
UINT_32 = Simulink.NumericType(DataTypeMode="Fixed-point: unspecified scaling", SignednessBool=false, WordLength=32, FixedExponent=0)
BOOL = Simulink.NumericType(DataTypeMode="Boolean", SignednessBool=false, WordLength=1, FixedExponent=0)
Ts = 5.0e-6
Tso = 0.001
Tsi = 0.0001
SimStopTime = Simulink.Parameter(1)
battery_pack_TimeStep = Simulink.Parameter(0.01)