% Simulink data dictionary bat_param_est_data.sldd
% references bat_param_before_estimated.sldd

StopTime = Simulink.Parameter(Simulink.data.Expression(ExpressionString="get_StopTime(\"synthData.mat\")"))
SOC_LUT = Simulink.Parameter(Simulink.data.Expression(ExpressionString="(0.1:.1:1)'"))
SOC0 = Simulink.Parameter(Simulink.data.Expression(ExpressionString="(Capacity - Qe_init) / Capacity"))
expTemperature = Simulink.Parameter([20 5 40])
Em_min = Simulink.Parameter(Simulink.data.Expression(ExpressionString="3*ones(size(SOC_LUT))"))
Em_max = Simulink.Parameter(Simulink.data.Expression(ExpressionString="4.2*ones(size(SOC_LUT))"))
R0 = Simulink.Parameter(Simulink.data.Expression(ExpressionString="0.01*ones(size(SOC_LUT))"))
R0_max = Simulink.Parameter(Simulink.data.Expression(ExpressionString="0.1*ones(size(SOC_LUT))"))
Em = Simulink.Parameter(Simulink.data.Expression(ExpressionString="3.8*ones(size(SOC_LUT))"))  % open-circuit voltage vs SOC
R0_min = Simulink.Parameter(Simulink.data.Expression(ExpressionString="0.001*ones(size(SOC_LUT))"))  % resistance vs SOC
R1_min = Simulink.Parameter(Simulink.data.Expression(ExpressionString="0.00001*ones(size(SOC_LUT))"))
R1_max = Simulink.Parameter(Simulink.data.Expression(ExpressionString="0.01*ones(size(SOC_LUT))"))
R1 = Simulink.Parameter(Simulink.data.Expression(ExpressionString="0.0005*ones(size(SOC_LUT))"))  % Resistance vs SOC
tau1_min = Simulink.Parameter(Simulink.data.Expression(ExpressionString="1*ones(size(SOC_LUT))"))
tau1_max = Simulink.Parameter(Simulink.data.Expression(ExpressionString="100*ones(size(SOC_LUT))"))
R2_min = Simulink.Parameter(Simulink.data.Expression(ExpressionString="0.00001*ones(size(SOC_LUT))"))
R2_max = Simulink.Parameter(Simulink.data.Expression(ExpressionString="0.01*ones(size(SOC_LUT))"))
R2 = Simulink.Parameter(Simulink.data.Expression(ExpressionString="0.0005*ones(size(SOC_LUT))"))  % Resistance vs SOC
tau1 = Simulink.Parameter(Simulink.data.Expression(ExpressionString="10*ones(size(SOC_LUT))"))  % Time Constant vs SOC
tau2_min = Simulink.Parameter(Simulink.data.Expression(ExpressionString="10*ones(size(SOC_LUT))"))
tau2_max = Simulink.Parameter(Simulink.data.Expression(ExpressionString="500*ones(size(SOC_LUT))"))
tau2 = Simulink.Parameter(Simulink.data.Expression(ExpressionString="100*ones(size(SOC_LUT))"))  % Time Constant vs SOC
R3 = Simulink.Parameter(Simulink.data.Expression(ExpressionString="0.0005*ones(size(SOC_LUT))"))  % Resistance vs SOC
R3_min = Simulink.Parameter(Simulink.data.Expression(ExpressionString="0.00001*ones(size(SOC_LUT))"))
R3_max = Simulink.Parameter(Simulink.data.Expression(ExpressionString="0.01*ones(size(SOC_LUT))"))
tau3 = Simulink.Parameter(Simulink.data.Expression(ExpressionString="500*ones(size(SOC_LUT))"))
tau3_min = Simulink.Parameter(Simulink.data.Expression(ExpressionString="100*ones(size(SOC_LUT))"))
tau3_max = Simulink.Parameter(Simulink.data.Expression(ExpressionString="5000*ones(size(SOC_LUT))"))
Capacity = Simulink.Parameter(31, Unit="A*hr")
Qe_init = Simulink.Parameter(0, Unit="A*hr")