% Simulink data dictionary passive_balancing_data.sldd

StopTime = Simulink.Parameter(Simulink.data.Expression(ExpressionString="3600*4"), Unit="s")
ambient_temperature = Simulink.Parameter(293, Unit="K")
SOC_LUT = Simulink.Parameter([0.1; 0.2; 0.3; 0.4; 0.5; 0.6; 0.7; 0.8; 0.9; 1])
Temperature_LUT = Simulink.Parameter([278.15 293.15 313.15])
Capacity_LUT = Simulink.Parameter([4 4 4])

Em_LUT = Simulink.Parameter([3.484072 3.493739 3.505929
 3.554181 3.552596 3.555083
 3.604404 3.614102 3.615154
 3.643215 3.648967 3.656857
 3.685022 3.688642 3.696397
 3.744226 3.743989 3.751058
 3.829679 3.839401 3.853251
 3.943159 3.948543 3.956083
 4.059438 4.060948 4.065656
 4.19049 4.190302 4.187992])

R0_LUT = Simulink.Parameter([0.01640255 0.009913916 0.009331684
 0.0119601 0.008750436 0.009561544
 0.01198531 0.00832298 0.008544552
 0.01113306 0.008720619 0.009561394
 0.01182229 0.007959094 0.008807548
 0.01167483 0.008565481 0.00938193
 0.01127686 0.008433308 0.009966491
 0.01189338 0.008503342 0.009600197
 0.01203213 0.008466024 0.009637533
 0.01240982 0.008465398 0.009298217])

R1_LUT = Simulink.Parameter([0.004705179 0.0002936384 0.0009485467
 0.002902751 0.0009064153 0.0002871275
 0.001738848 0.001265081 0.00118355
 0.001668677 0.0003146218 0.000269194
 0.0009224172 0.001152547 0.000615958
 0.001206013 0.0004844964 0.0002637191
 0.00134107 0.0007226628 4.844409e-05
 0.001027283 0.0007885936 0.0002874824
 0.001071126 0.0008089646 0.000207426
 0.001097629 0.0007946322 0.000106864])

C1_LUT = Simulink.Parameter([2887.703 33086.41 4549.515
 4322.856 13371.38 79281.92
 4303.638 9514.859 7004.711
 5660.426 34662.17 35331.9
 10025.62 8026.841 7609.202
 10795.38 27790.93 29313.97
 8403.293 14186.89 223825.7
 10303.83 12734.3 38151.55
 8639.276 11929.78 56393.86
 9127.815 12691.26 92432.85])

cell_mass = Simulink.Parameter(0.84)
cell_Cp_heat = Simulink.Parameter(964.92)
cell_area = Simulink.Parameter(0.1019)
h_conv = Simulink.Parameter(5)
initial_temperature = Simulink.Parameter(293.15, Unit="K")
initial_SOC = Simulink.Parameter([0.2; 0.22; 0.24])
R_bleed = Simulink.Parameter(20)
delta_V = Simulink.Parameter(0.01)
TimeStep = Simulink.Parameter(0.1)
input_current = Simulink.Parameter(0.8)

DISCHARGE_FLAG = enum(DefaultValue="ON", StorageType="int8")
  OFF = 0
  ON = 1